# Dynamo graph 05_Write-CA-Legend.dyn (Dynamo 2.16.2.5624)

# group: Current Project
current = Document.Current()
filePath = Document.FilePath(document=current)

# group: Return the Folder of the Current Project
code_block = CodeBlock { "\\"; }
code_block_2 = CodeBlock { "\\"; }
split = String.Split(string=filePath, separator0=code_block_2)
code_block_3 = CodeBlock { -1; }
dropItems = List.DropItems(list=split, amount=code_block_3)
join = String.Join(separator=code_block, string0=dropItems)

# group: Master Check Template Location
file_path = Filename("Templates\02_Master-Check.xlsx")
file_from_path = FileObject(path=file_path)
string_from_object = FromObject(object=file_from_path)

# group: Return the File Name of the Master Check Template
code_block_4 = CodeBlock { "\\"; }
code_block_5 = CodeBlock { "\\"; }
split_2 = String.Split(string=string_from_object, separator0=code_block_5)
lastItem = List.LastItem(list=split_2)
join_2 = String.Join(separator=code_block_4, string0=lastItem)

# group: Combine Into the Current Project Path and Template Name for Master Check
code_block_6 = CodeBlock { "\\"; }
combinePath = FileSystem.CombinePath(string0=join, string1=join_2)
join_3 = String.Join(separator=code_block_6, string0=combinePath)

# group: Read from Takeoff Excel
file_from_path_2 = FileObject(path=join_3)
string = StringInput("CA")
boolean = BoolSelector(true)
boolean_2 = BoolSelector(true)
importExcel = Data.ImportExcel(file=file_from_path_2, sheetName=string, readAsStrings=boolean, showExcel=boolean_2)

watch = Watch(importExcel)
code_block_7 = CodeBlock { "DSP Comp Ref"; }
python_script = Python(IN[0]=code_block_7)  # CPython3
# ---------- python_script.python (43 lines) ----------
import clr
clr.AddReference("RevitAPI")
clr.AddReference("RevitServices")
from Autodesk.Revit.DB import *
from RevitServices.Persistence import DocumentManager

# Inputs
doc = DocumentManager.Instance.CurrentDBDocument

# Debugging step: check if input exists and its type
if len(IN) < 1:
    OUT = "Error: Input list is empty. Please provide an input string for the legend name."
    raise SystemExit

# Attempt to retrieve the legend name, and handle if it fails
try:
    legend_name = IN[0]
    # Debugging: print input type and content to see what is being received
    OUT = f"Input received: Type = {type(legend_name)}, Content = {legend_name}"
except IndexError:
    OUT = "Error: Unable to read input from IN[0]. Please verify the input connection."
    raise SystemExit

# Ensure the input is of the correct type (str)
if not isinstance(legend_name, str):
    OUT = f"Error: Input must be a string, received type {type(legend_name)}. Please use a string node."
    raise SystemExit

# Get all views in the document
collector = FilteredElementCollector(doc).OfClass(View)

# Filter only Legend Views with the specified name
specific_legend = None
for view in collector:
    if view.ViewType == ViewType.Legend and view.Name.strip() == legend_name.strip():
        specific_legend = view
        break

# Check if the legend was found and output the result
if specific_legend is None:
    OUT = f"Legend with name '{legend_name}' not found."
else:
    OUT = specific_legend
# ----------------------------------------

# group: Process Legend Sub-Header on Sheet
code_block_8 = CodeBlock { "MULTI-DECK DAIRY"; }
python_script_2 = Python(IN[0]=python_script, IN[1]=code_block_8)  # CPython3
# ---------- python_script_2.python (65 lines) ----------
import clr
clr.AddReference("RevitAPI")
clr.AddReference("RevitServices")
from Autodesk.Revit.DB import *
from RevitServices.Persistence import DocumentManager
import re

# Inputs
doc = DocumentManager.Instance.CurrentDBDocument
legend_view = UnwrapElement(IN[0])  # Legend View input
target_sub_header_text = IN[1]  # The sub-header text to extract (e.g., "MULTI-DECK FROZEN FOOD")

# Collect all TextNote elements in the Legend View
collector = FilteredElementCollector(doc, legend_view.Id).OfClass(TextNote)
text_notes = []

for text_note in collector:
    location = text_note.Coord  # XYZ location of the Text Note
    element_data = {
        "ElementId": text_note.Id.IntegerValue,
        "Text": text_note.Text,
        "Location": location
    }
    text_notes.append(element_data)

# Preprocess the target text to remove extra whitespace and normalize line breaks
target_sub_header_text_clean = re.sub(r'\s+', ' ', target_sub_header_text.strip()).upper()

# Group text notes by rows (based on Y-coordinate)
tolerance = 0.1  # Tolerance for determining whether two text notes are in the same row
rows = []

for text_note in text_notes:
    y_coord = text_note["Location"].Y
    found_row = False
    for row in rows:
        if abs(row[0]["Location"].Y - y_coord) < tolerance:
            row.append(text_note)
            found_row = True
            break
    if not found_row:
        rows.append([text_note])

# Sort rows by Y-coordinate (descending order for top to bottom)
sorted_rows = sorted(rows, key=lambda r: -r[0]["Location"].Y)

# Sort elements within each row by X-coordinate (ascending order for left to right)
for row in sorted_rows:
    row.sort(key=lambda e: e["Location"].X)

# Find the row that matches the target sub-header text
target_row_data = None

for row in sorted_rows:
    # Check each element in the row to find the target text
    for element in row:
        element_text_clean = re.sub(r'\s+', ' ', element["Text"].strip()).upper()
        if element_text_clean == target_sub_header_text_clean:
            target_row_data = row
            break
    if target_row_data:
        break

# Output the matched row (sub-header row)
OUT = target_row_data
# ----------------------------------------

watch_2 = Watch(python_script_2)

# group: Process Legend Sub-Header on Sheet
code_block_9 = CodeBlock { "MULTI-DECK MEAT DELI"; }
python_script_3 = Python(IN[0]=python_script, IN[1]=code_block_9)  # CPython3; same code as python_script_2

# group: Process Legend Sub-Header on Sheet
code_block_10 = CodeBlock { "MULTI-DECK MEAT DELI"; }
python_script_4 = Python(IN[0]=python_script, IN[1]=code_block_10)  # CPython3; same code as python_script_2

# group: Process Legend Sub-Header on Sheet
code_block_11 = CodeBlock()
# ---------- code_block_11.designscript (2 lines) ----------
"TOTAL FROZEN FOOD
(NUMBER OF DOORS)";
# ----------------------------------------
python_script_5 = Python(IN[0]=python_script, IN[1]=code_block_11)  # CPython3; same code as python_script_2

# group: Process Legend Sub-Header on Sheet
code_block_12 = CodeBlock { "WINE / LIQUOR SHELVING"; }
python_script_6 = Python(IN[0]=python_script, IN[1]=code_block_12)  # CPython3; same code as python_script_2

# group: Process Legend Sub-Header on Sheet
code_block_13 = CodeBlock { "CENTER STORE"; }
python_script_7 = Python(IN[0]=python_script, IN[1]=code_block_13)  # CPython3; same code as python_script_2

# group: Process Legend Sub-Header on Sheet
code_block_14 = CodeBlock { "TOTAL SHELVING"; }
python_script_8 = Python(IN[0]=python_script, IN[1]=code_block_14)  # CPython3; same code as python_script_2

# group: Process Legend Sub-Header on Sheet
code_block_15 = CodeBlock { "MULTI-DECK FROZEN PROMO"; }
python_script_9 = Python(IN[0]=python_script, IN[1]=code_block_15)  # CPython3; same code as python_script_2

# group: Process Legend Sub-Header on Sheet
code_block_16 = CodeBlock { "MULTI-DECK SEAFOOD & MEAT"; }
python_script_10 = Python(IN[0]=python_script, IN[1]=code_block_16)  # CPython3; same code as python_script_2

# group: Process Legend Sub-Header on Sheet
code_block_17 = CodeBlock { "MULTI-DECK FROZEN FOOD"; }
python_script_11 = Python(IN[0]=python_script, IN[1]=code_block_17)  # CPython3; same code as python_script_2

# group: Process Legend Sub-Header on Sheet
code_block_18 = CodeBlock { "MULTI-DECK MEAT DELI"; }
python_script_12 = Python(IN[0]=python_script, IN[1]=code_block_18)  # CPython3; same code as python_script_2

# group: Process Legend Sub-Header on Sheet
code_block_19 = CodeBlock { "MULTI-DECK MEAT DELI"; }
python_script_13 = Python(IN[0]=python_script, IN[1]=code_block_19)  # CPython3; same code as python_script_2

# group: Process Legend Sub-Header on Sheet
code_block_20 = CodeBlock()
# ---------- code_block_20.designscript (2 lines) ----------
"DAIRY COOLER DOORS
(DOOR QTY x 2.5)";
# ----------------------------------------
python_script_14 = Python(IN[0]=python_script, IN[1]=code_block_20)  # CPython3; same code as python_script_2

# group: Process Legend Sub-Header on Sheet
code_block_21 = CodeBlock { "MULTI-DECK MEAT"; }
python_script_15 = Python(IN[0]=python_script, IN[1]=code_block_21)  # CPython3; same code as python_script_2

watch_3 = Watch(python_script_15)

# group: Process Legend Sub-Header on Sheet
code_block_22 = CodeBlock { "SERVICE SEAFOOD & MEAT"; }
python_script_16 = Python(IN[0]=python_script, IN[1]=code_block_22)  # CPython3; same code as python_script_2

watch_4 = Watch(python_script_16)

# group: MULTI-DECK PRODUCE
code_block_23 = CodeBlock { "MULTI-DECK PRODUCE"; }

# group: MULTI-DECK PRODUCE > Sub-Header in Legend
python_script_17 = Python(IN[0]=python_script, IN[1]=code_block_23)  # CPython3; same code as python_script_2

watch_5 = Watch(python_script_17)
code_block_24 = CodeBlock { 1; }
flatten = List.Flatten(list=importExcel, amount=code_block_24)
python_script_18 = Python(IN[0]=flatten)  # CPython3
# ---------- python_script_18.python (43 lines) ----------
# Input from Excel Import Node (flattened data)
excel_data = IN[0]

# Initialize an empty list to hold the dictionaries
dictionary_rows = []

try:
    # Iterate through each row in the Excel data
    for row in excel_data:
        # Ensure row is a list and has meaningful data in the first six fields (Header, SubHeader, Type, Existing, Proposed, Variation)
        if isinstance(row, list) and len(row) >= 6:
            # Extract and format the required data, providing sensible default values where necessary
            header = row[0] if row[0] is not None else "N/A"
            sub_header = row[1] if row[1] is not None else "N/A"
            item_type = row[2] if row[2] is not None else "N/A"
            existing = row[3] if row[3] is not None else 0
            proposed = row[4] if row[4] is not None else 0
            variation = row[5] if row[5] is not None else 0

            # Only include rows with meaningful sub-header data (ignore entirely empty rows)
            if sub_header != "N/A":
                # Create a dictionary for the row
                row_dict = {
                    "Header": header,
                    "SubHeader": sub_header,
                    "Type": item_type,
                    "Existing": existing,
                    "Proposed": proposed,
                    "Variation": variation
                }

                # Append the dictionary to the list
                dictionary_rows.append(row_dict)

    # Set output to the list of dictionaries
    if not dictionary_rows:
        OUT = "No valid rows found in input data. Check the structure of the input or revise the extraction logic."
    else:
        OUT = dictionary_rows

except Exception as e:
    # Output any errors that occur
    OUT = "Error occurred: {}".format(str(e))
# ----------------------------------------
watch_6 = Watch(python_script_18)

# group: MULTI-DECK PRODUCE > Sub-Header in Excel
python_script_19 = Python(IN[0]=watch_6, IN[1]=code_block_23)  # CPython3
# ---------- python_script_19.python (45 lines) ----------
import re

# Input from Excel Import Node
excel_data = IN[0]  # Input Excel data (deeply nested structure)
target_sub_header_text = IN[1]  # The sub-header text we are looking for

# Clean the target text to remove extra spaces, normalize line breaks, and convert to upper case
target_sub_header_text_clean = re.sub(r'\s+', ' ', target_sub_header_text.strip()).upper()

output_data = []

# Function to flatten nested lists
def flatten_list(data):
    flat_list = []
    if isinstance(data, list):
        for item in data:
            flat_list.extend(flatten_list(item))
    else:
        flat_list.append(data)
    return flat_list

# Flatten the deeply nested list structure to access the actual rows
flattened_data = flatten_list(excel_data)

# Iterate through the flattened data to find rows (each row is a list)
for row in flattened_data:
    if isinstance(row, list) and len(row) >= 2:
        subcategory = row[1]

        # Check if the subcategory is a string and is not None
        if subcategory is not None and isinstance(subcategory, str):
            # Normalize the text for consistent comparison
            subcategory_clean = re.sub(r'\s+', ' ', subcategory.strip()).upper()

            # Debugging: Print the cleaned sub-header to see exactly what we are matching
            print(f"Sub-Header in Row: '{subcategory_clean}'")
            print(f"Target Sub-Header: '{target_sub_header_text_clean}'")

            # Final matching check
            if target_sub_header_text_clean == subcategory_clean:
                output_data = row
                break

# Output the transformed data focusing on the specific sub-header
OUT = output_data if output_data else f"No matching sub-header found for: '{target_sub_header_text_clean}'"
# ----------------------------------------

watch_7 = Watch(python_script_19)
python_script_20 = Python(IN[0]=importExcel)  # CPython3
# ---------- python_script_20.python (13 lines) ----------
# Input from Excel Import Node (with readAsString=True assumed)
raw_excel_data = IN[0]

# Step 1: Inspect Level 1
if isinstance(raw_excel_data, list):
    OUT = f"Level 1: {len(raw_excel_data)} elements"
    OUT = raw_excel_data
else:
    OUT = "Unexpected structure at Level 1"

# After running this script, please inspect the output and provide some details, such as:
# - The number of elements at Level 1
# - Are they lists or something else?
# ----------------------------------------
watch_8 = Watch(python_script_20)
watch_9 = Watch(flatten)
